test file "LaneFollowingTestScenarios"
  coverage: Decision, MCDC, Condition

suite "Scenarios"

  case "ACC_ISO_TargetDiscriminationTest" [simulation]
    description: New description
    model LaneFollowingTestBenchExample, mode Normal
    post-load callback:
      scenarioId = 1;
      helperLFSetUp;
    cleanup callback:
      close_system(LaneFollowingTestBenchExample, 0)
    custom criteria (off):
      helperPlotResults(sltest_simout.logsout);

  case "ACC_ISO_AutoRetargetTest" [simulation]
    model LaneFollowingTestBenchExample, mode Normal
    post-load callback:
      scenarioId = 2;
      helperLFSetUp;
    cleanup callback:
      close_system(LaneFollowingTestBenchExample, 0)
    custom criteria (off):
      helperPlotResults(sltest_simout.logsout);

  case "ACC_ISO_CurveTest" [simulation]
    model LaneFollowingTestBenchExample, mode Normal
    post-load callback:
      scenarioId = 3;
      helperLFSetUp;
    cleanup callback:
      close_system(LaneFollowingTestBenchExample, 0)
    custom criteria (off):
      helperPlotResults(sltest_simout.logsout);

  case "ACC_StopnGo" [simulation]
    model LaneFollowingTestBenchExample, mode Normal
    post-load callback:
      scenarioId = 4;
      helperLFSetUp;
    cleanup callback:
      close_system(LaneFollowingTestBenchExample, 0)
    custom criteria (off):
      helperPlotResults(sltest_simout.logsout);

  case "LFACC_DoubleCurve_DecelTarget" [simulation]
    model LaneFollowingTestBenchExample, mode Normal
    post-load callback:
      scenarioId = 5;
      helperLFSetUp;
    cleanup callback:
      close_system(LaneFollowingTestBenchExample, 0)
    custom criteria (off):
      helperPlotResults(sltest_simout.logsout);

  case "LFACC_DoubleCurve_AutoRetarget" [simulation]
    model LaneFollowingTestBenchExample, mode Normal
    post-load callback:
      scenarioId = 6;
      helperLFSetUp;
    cleanup callback:
      close_system(LaneFollowingTestBenchExample, 0)
    custom criteria (off):
      helperPlotResults(sltest_simout.logsout);

  case "LFACC_DoubleCurve_StopnGo" [simulation]
    model LaneFollowingTestBenchExample, mode Normal
    post-load callback:
      scenarioId = 7;
      helperLFSetUp;
    cleanup callback:
      close_system(LaneFollowingTestBenchExample, 0)
    custom criteria (off):
      helperPlotResults(sltest_simout.logsout);

  case "LFACC_Curve_CutInOut" [simulation]
    model LaneFollowingTestBenchExample, mode Normal
    post-load callback:
      scenarioId = 8;
      helperLFSetUp;
    cleanup callback:
      close_system(LaneFollowingTestBenchExample, 0)
    custom criteria (off):
      helperPlotResults(sltest_simout.logsout);

  case "LFACC_Curve_CutInOut_TooClose" [simulation]
    model LaneFollowingTestBenchExample, mode Normal
    post-load callback:
      scenarioId = 9;
      helperLFSetUp;
    cleanup callback:
      close_system(LaneFollowingTestBenchExample, 0)
    custom criteria (off):
      helperPlotResults(sltest_simout.logsout);